# Grasshopper definition image-import-to-rhino.gh (Grasshopper 1.0.8)

panel = Panel("C:/Users/Varun SA/Documents/rhino-sketch-interface/sketches")
boolean_toggle = BooleanToggle(True)
panel_2 = Panel("C:\Users\Varun SA\Documents\rhino-sketch-interface\rhino-lines\rhino-lines.json")
geometry_pipeline = GeometryPipeline(
    GroupByLayer=False,
    GroupByType=False,
    IncludeHidden=True,
    IncludeLocked=True,
    LayerFilter="gen-geo",
    NameFilter="*",
    SublayerFiltering=True,
    TypeFilter=4)
python_3_script = Python3Script(folder=panel, refresh=boolean_toggle)  # -> a
# ---------- python_3_script: Python ----------
import os

# Only run if the button is clicked
if refresh:

    # Check if folder exists
    if not os.path.exists(folder):
        a = "Folder does not exist"

    else:
        # List all numbered PNG files
        pngs = [
            f for f in os.listdir(folder)
            if f.endswith(".png") and f.split(".")[0].isdigit()
        ]

        if not pngs:
            a = "No PNG files found"
        else:
            # Pick the one with the highest number
            highest_file = max(pngs, key=lambda x: int(x.split(".")[0]))

            # Create full path
            image_path = os.path.join(folder, highest_file)

            # Output the latest path
            a = image_path
else:
    # If refresh is not clicked, keep output empty
    a = None
# ---------- end python_3_script ----------
panel_3 = Panel(geometry_pipeline)
import_image = ImportImage(File=python_3_script)
scale = Scale(Geometry=import_image, Center=Point(0, 0, 0), Factor=Slider(2, range=0.1..100))  # -> Geometry, Transform
python_3_script_2 = Python3Script(geo=geometry_pipeline, image_geom=scale.Geometry, path=panel_2, trigger=boolean_toggle)  # -> out, a
# ---------- python_3_script_2: Python ----------
import json
import Rhino.Geometry as rg

def RunScript(self, geo, image_geom, path, trigger):
    # Exit early if not triggered
    if not trigger:
        return

    # Get bounding box of the image surface or mesh
    bbox = image_geom.GetBoundingBox(True)
    min_pt = bbox.Min
    max_pt = bbox.Max

    # Calculate width and height of the bounding box
    box_width = max_pt.X - min_pt.X
    box_height = max_pt.Y - min_pt.Y

    # Prepare a list to hold all normalized line data
    normalized_lines = []

    # Iterate through all input geometry (lines/curves)
    for item in geo:
        if isinstance(item, rg.Curve):
            # Divide curve into 50 points
            parameters = item.DivideByCount(50, True)
            if parameters:
                line_pts = []
                for t in parameters:
                    pt = item.PointAt(t)

                    # Normalize point using bounding box, flip Y for canvas orientation
                    x = (pt.X - min_pt.X) / box_width
                    y = 1 - (pt.Y - min_pt.Y) / box_height

                    line_pts.append([x, y])

                # Add this curve's points to the list
                normalized_lines.append(line_pts)

    # Write the output to JSON file
    with open(path, "w") as f:
        json.dump(normalized_lines, f, indent=2)
# ---------- end python_3_script_2 ----------
panel_4 = Panel(scale.Geometry)
